# Grasshopper definition light painting color2.gh (Grasshopper 0.9.76)
# plug-ins: Python Interpreter, Tree8

contour_distance = Slider(2, range=0..10)
mesh = Mesh(<mesh referenced from the Rhino model>)
Z = UnitZ(Factor=Slider(180, range=0..1000))
pt = ConstructPoint(XCoordinate=0, YCoordinate=0, ZCoordinate=0)
cir = Circle(Plane=pt, Radius=expr("x/2", Slider(110, range=0..1000)))
extr = Extrude(Base=cir, Direction=Z)
bbox = BoundingBox(Content=mesh, Plane=PlaneXY(0, 0, 0))  # -> Box, Box_2
base_point = Point(pt)
debrep = DeconstructBrep(Brep=bbox.Box)  # -> Faces, Edges, Vertices
Z_2 = UnitZ(Factor=1)
max_outer_radius = Slider(105, range=0..1000)
item = ListItem(List=debrep.Faces, Index=Slider(4, range=0..10), Wrap=True)
item_2 = ListItem(List=debrep.Edges, Index=0, Wrap=True)
item_3 = ListItem(List=debrep.Edges, Index=Slider(1, range=0..10), Wrap=True)
area = Area(Geometry=item)  # -> Area, Centroid
len = Length(Curve=item_3)
len_2 = Length(Curve=item_2)
pdecon = Deconstruct(Point=area.Centroid)  # -> XComponent, YComponent, ZComponent
max = Maximum(A=len_2, B=len)
X = UnitX(Factor=expr("-x", pdecon.XComponent))
Y = UnitY(Factor=expr("-x", pdecon.YComponent))
division = Division(A=max_outer_radius, B=max)
move = Move(Geometry=mesh, Motion=X)  # -> Geometry, Transform
Z_3 = UnitZ(Factor=expr("-x", pdecon.ZComponent))
move_2 = Move(Geometry=move.Geometry, Motion=Y)  # -> Geometry, Transform
number_slider = Slider(5, range=0..100)
Z_4 = UnitZ(Factor=Slider(20, range=0..100))
move_3 = Move(Geometry=move_2.Geometry, Motion=Z_3)  # -> Geometry, Transform
scale = Scale(Geometry=move_3.Geometry, Center=base_point, Factor=division)  # -> Geometry, Transform
X_2 = UnitX(Factor=expr("-x", number_slider))
move_4 = Move(Geometry=scale.Geometry, Motion=Z_4)  # -> Geometry, Transform
prefix_gcode = Panel(""";code generated for light painting
;by grass hopper

G28
G90
G21""")
postfix_gcode = Panel("G28")
gcode_to_switch = Panel("M42")
led_pin = Panel("11")
led_pin_value = Panel("255")
led_pin_value_2 = Panel("0")
move_5 = Move(Geometry=move_4.Geometry, Motion=X_2)  # -> Geometry, Transform
number_slider_2 = Slider(255, range=0..1000)
Y_2 = UnitY(Factor=number_slider)
feed_rate = Panel("3500")
move_6 = Move(Geometry=move_5.Geometry, Motion=Y_2)  # -> Geometry, Transform
mesh_2 = Mesh(move_6.Geometry)
python = PythonScript(M=mesh_2)  # -> V, N, T, C; inputs M: Mesh
# ---------- python: Python ----------
V = M.Vertices
N = M.Normals
T = M.TextureCoordinates
C = M.VertexColors
# ---------- end python ----------
image = ImageSampler(
    python.T,
    FilePath="D:\projects\AITTA\thick mesh\0_1.BMP",
    Filter="Colour",
    Interpolate=False,
    Umax=1,
    Umin=0,
    Vmax=1,
    Vmin=0,
    Wrap=1)
mcol = MeshColours(Mesh=mesh_2, Colours=image)
contour = Contour(Shape=mesh_2, Point=base_point, Direction=Z_2, Distance=contour_distance)
hack = VBScript(m=mcol)  # -> out, A; inputs m: Mesh
# ---------- hack: VB ----------
    If m IsNot Nothing Then
      Dim msh As New mesh
      Dim fcs As Rhino.Geometry.Collections.MeshFaceList
      Dim verts As Rhino.Geometry.Collections.MeshVertexList
      Dim nrms As rhino.Geometry.Collections.MeshVertexNormalList
      Dim clrs As Rhino.Geometry.Collections.MeshVertexColorList

      fcs = m.Faces
      verts = m.Vertices
      nrms = m.Normals
      clrs = m.VertexColors

      For i As Integer = 0 To verts.count() - 1 Step 1
        Dim x As New Vector3f (clrs.item(i).R, clrs.item(i).G, clrs.item(i).B)
        nrms.SetNormal(i, x)
      Next
      msh.Vertices.AddVertices(verts.toarray())
      msh.Faces.AddFaces(fcs.ToArray())
      msh.Normals.AddRange(nrms.ToArray())
      A = msh
    End If
# ---------- end hack ----------
explode = Explode(Curve=contour, Recursive=True)  # -> Segments, Vertices
meshcp = MeshClosestPoint(Point=explode.Vertices, Mesh=mcol)  # -> Point, Index, Parameter
meval = MeshEval(Mesh=hack.A, Parameter=meshcp.Parameter)  # -> Point, Normal, Colour
devec = DeconstructVector(Vector=meval.Normal)  # -> XComponent, YComponent, ZComponent
rgb = ColourRGB(Alpha=255, Red=devec.XComponent, Green=devec.YComponent, Blue=devec.ZComponent)
preview = CustomPreview(Geometry=meval.Point, Shader=rgb)
argb = SplitARGB(Colour=rgb)  # -> Alpha, Red, Green, Blue
num = Number(led_pin_value_2)
num_2 = Number(led_pin)
num_3 = Number(feed_rate)
num_4 = Number(led_pin_value)
multiplication = Multiplication(A=argb.Blue, B=number_slider_2)
multiplication_2 = Multiplication(A=argb.Red, B=number_slider_2)
multiplication_3 = Multiplication(A=argb.Green, B=number_slider_2)
led_off = Evaluate(F="Format(\"{0:X } {1:P0 }{2:S0 }\",x,y,z)", x=gcode_to_switch, y=num_2, z=num)
led_off_2 = Evaluate(F="Format(\"{0:X } {1:P12 }{2:S0 }\",x,y,z)", x=gcode_to_switch, y=num_2, z=num)
led_off_3 = Evaluate(F="Format(\"{0:X } {1:P13 }{2:S0 }\",x,y,z)", x=gcode_to_switch, y=num_2, z=num)
pdecon_2 = Deconstruct(Point=meval.Point)  # -> XComponent, YComponent, ZComponent
red = Evaluate(F="Format(\"{0:M42 P11 S0 }\",r)", r=multiplication_2)
green = Evaluate(F="Format(\"{0:M42 P13 S0 }\",r)", r=multiplication)
blue = Evaluate(F="Format(\"{0:M42 P12 S0 }\",r)", r=multiplication_3)
all_pins_off = Merge(Data1=led_off, Data2=led_off_2, Data3=led_off_3)
eval = Evaluate(
    F="Format(\"{0:G1 X0.00 }{1:Y0.00 }{2:Z0.00}{3: F0 }\",x,y,z,f)",
    x=pdecon_2.XComponent,
    y=pdecon_2.YComponent,
    z=pdecon_2.ZComponent,
    F_2=num_3)
number_slider_3 = Slider(8, range=0..10)
weave_color = Weave(Pattern=[0, 1, 2], Stream0=red, Stream1=blue, Stream2=green, NullGaps=False)
rep = ReplaceString(String=eval, Find="-G1 X", Replace="G1 X-", RecursiveReplace=False)
rep_2 = ReplaceString(String=rep, Find="-Y", Replace="Y-", RecursiveReplace=False)
weave_gcode_and_color = Weave(Pattern=[0, 1, 1, 1], Stream0=rep_2, Stream1=weave_color, NullGaps=False)
viewer = ParamViewer(weave_gcode_and_color)
path_mapper = PathMapper(weave_gcode_and_color, source="{A;B;C;D;E}", target="{A;B;D}")
tstat = TreeStatistics(Tree=path_mapper)  # -> Paths, Length, Count
dup = DuplicateData(Data=all_pins_off, Number=tstat.Count, Order=True)
allocn = DataAllocationN(Data=dup, NumberOfItems=Slider(3, range=0..10))
path_mapper_2 = PathMapper(allocn, source="{A;B;C;D;E}", target="{A;B;E}")
subtraction = Subtraction(A=tstat.Count, B=1)
panel = Panel(path_mapper_2)
panel_2 = Panel(weave_gcode_and_color)
viewer_2 = ParamViewer(path_mapper)
merge = Merge(Data1=path_mapper, Data2=path_mapper_2)
merge_2 = Merge(Data1=prefix_gcode, Data2=flatten(merge))
merge_3 = Merge(Data1=flatten(merge_2), Data2=postfix_gcode)
panel_4 = Panel(merge_3)
